# Grasshopper definition bridge.gh (Grasshopper 1.0.7)
# plug-ins: Kangaroo2 Components

crv = Curve([<curve referenced from the Rhino model> x20])
extr = Extrude(Base=crv, Direction=Vector(0, 10, 0))
cap = CapHoles(Brep=extr)
custom_mesh_settings = SettingsCustom(
    StitchSeams=True,
    SimplePlanes=True,
    Refine=False,
    MinCount=1,
    MaxCount=400,
    AspectRatio=20,
    MaxDistance=0,
    MaxAngle=20,
    MinEdge=0,
    MaxEdge=0)
scale = Scale(Geometry=cap, Center=Point(0, 0, 0), Factor=Slider(0.05, range=0..0.1))  # -> Geometry, Transform
mesh = MeshBrep(Brep=scale.Geometry, Settings=custom_mesh_settings)
clean = CombineClean(Meshes=graft(mesh))
