# Grasshopper definition shelf.gh (Grasshopper 1.0.7)
# plug-ins: Kangaroo2 Components

vec2pt = Vector2Pt(PointA=Point(1.020408154, 0, 1), PointB=Point(1.020408273, 0.200000003, 1), Unitize=False)  # -> Vector, Length
crv = Curve([<curve referenced from the Rhino model> x12])
extr = Extrude(Base=crv, Direction=vec2pt.Vector)
cap = CapHoles(Brep=extr)
geo = Geometry(cap)
scale = Scale(Geometry=geo, Center=Point(0, 0, 0), Factor=Slider(0.05, range=0..0.1))  # -> Geometry, Transform
custom_mesh_settings = SettingsCustom(
    StitchSeams=True,
    SimplePlanes=Toggle(True),
    Refine=False,
    MinCount=1,
    MaxCount=400,
    AspectRatio=20,
    MaxDistance=0,
    MaxAngle=20,
    MinEdge=0,
    MaxEdge=0)
mesh = MeshBrep(Brep=geo, Settings=custom_mesh_settings)
clean = CombineClean(Meshes=graft(mesh))
